% Simulink data dictionary Three_Tank.sldd

Three_Tank_Inputs = Simulink.Bus()
  Digital_Inputs: boolean[8]
  Analog_Inputs: double[8]

Three_Tank_Outputs = Simulink.Bus()
  Digital_Outputs: boolean[8]
  Analog_Outputs: double[8]

UI_Inputs = Simulink.Bus()
  Digital_Inputs: boolean[8]
  Analog_Inputs: double[8]

UI_Outputs = Simulink.Bus()
  Digital_Outputs: boolean[8]
  Analog_Outputs: double[8]